# Dynamo graph JsonParser-Assembly1.dyn (Dynamo 1.2.0.2690)

groupByKey = List.GroupByKey()  # unwired: list, keys
count = Count(groupByKey.groups@L2)
code_block = CodeBlock(x=count) { x<300; }
filterByBoolMask = List.FilterByBoolMask(list=groupByKey.unique_keys, mask=code_block)
watch = Watch(filterByBoolMask.in)
filterByBoolMask_2 = List.FilterByBoolMask(list=count, mask=code_block)
watch_2 = Watch(filterByBoolMask_2.in)
maximumItem = List.MaximumItem(watch_2)
code_block_2 = CodeBlock(x=maximumItem) { x+5; 0; }
domain = Charts.MiscNodes.Domain(code_block_2.out1, code_block_2.out0)
data = Charts.BarChart.Data(watch, watch_2, domain)
code_block_3 = CodeBlock { 150; }
margins = Charts.MiscNodes.Margins(arg1=code_block_3)
code_block_4 = CodeBlock { 900; }
code_block_5 = CodeBlock { "Total Number of Changed Items"; }
code_block_6 = CodeBlock { 3; }
code_block_7 = CodeBlock { 90; }
style = Charts.BarChart.Style(arg3=margins, arg4=code_block_4, arg5=code_block_4, arg6=code_block_5, arg7=code_block_6, arg8=code_block_7)
chart = Charts.BarChart.Chart(data, style)
create_report = MandrillReportNode(chart)  # unwired: arg1, arg2
report_window = MandrillWindowNodeModel(create_report)
code_block_8 = CodeBlock { 2; }
dropEveryNthItem = List.DropEveryNthItem(n=code_block_8)  # unwired: list
dropEveryNthItem_2 = List.DropEveryNthItem(list=dropEveryNthItem, n=code_block_8)
dropEveryNthItem_3 = List.DropEveryNthItem(list=dropEveryNthItem_2, n=code_block_8)
groupByKey_2 = List.GroupByKey(list=dropEveryNthItem_3, keys=dropEveryNthItem_3)
watch_3 = Watch(filterByBoolMask.out)
containsItem = List.ContainsItem(list=watch_3, item=groupByKey_2.groups)
filterByBoolMask_3 = List.FilterByBoolMask(list=groupByKey_2.groups, mask=containsItem)
count_2 = Count(filterByBoolMask_3.out@L2)
code_block_9 = CodeBlock(x=count_2) { x>0; }
filterByBoolMask_4 = List.FilterByBoolMask(list=filterByBoolMask_3.out, mask=code_block_9)
watch_4 = Watch(filterByBoolMask_4.in)
firstItem = List.FirstItem(watch_4@L2)
count_3 = Count(filterByBoolMask_4.in@L2)
count_4 = Count(count_3)
randomList = Math.RandomList(count_4)
code_block_10 = CodeBlock(x=randomList) { x*50; }
code_block_11 = CodeBlock(x=count_3, y=code_block_10) { x+y; }
ceiling = Math.Ceiling(code_block_11)
code_block_12 = CodeBlock(x=count_3, y=ceiling) { x/y*100; }
maximumItem_2 = List.MaximumItem(code_block_12)
domain_2 = Charts.MiscNodes.Domain(arg1=maximumItem_2)
data_2 = Charts.LineChart.Data(firstItem, code_block_12, domain_2)
style_2 = Charts.LineChart.Style()
chart_2 = Charts.LineChart.Chart(data_2, style_2)
file_path = Filename("..\JSON\Test-A-V2-ChangesModified.json")
fromPath = FileObject(file_path)  # "File.FromPath"
watch_5 = Watch(fromPath)
readFromFile = DynamoJson.FileHelper.ReadFromFile(file_path)
toSublists = DynamoJson.JsonParser.ToSublists(readFromFile)
toDictionary = DynamoJson.JsonParser.ToDictionary(readFromFile)
getKeys = GetKeys(toDictionary)
code_block_13 = CodeBlock { "Changes"; }
indexOf = IndexOf(getKeys, code_block_13)
getItemAtIndex = List.GetItemAtIndex(list=toSublists, index=indexOf)
restOfItems = List.RestOfItems(getItemAtIndex)
code_block_14 = CodeBlock { 1; }
flatten = List.Flatten(list=restOfItems, amt=code_block_14)
transpose = List.Transpose(flatten@L3)
code_block_15 = CodeBlock { 1; }
getItemAtIndex_2 = List.GetItemAtIndex(list=transpose@L3, index=code_block_15)
code_block_16 = CodeBlock { 0; }
getItemAtIndex_3 = List.GetItemAtIndex(list=transpose@L3, index=code_block_16)
code_block_17 = CodeBlock { "Category"; }
indexOf_2 = IndexOf(getItemAtIndex_3@@L2, code_block_17)
list_getitematindex_category = List.GetItemAtIndex(list=getItemAtIndex_2@L2, index=indexOf_2@L1)
flatten_2 = Flatten(list_getitematindex_category)
code_block_18 = CodeBlock { 1; 1; }
address = Charts.MiscNodes.Address(code_block_18.out0, code_block_18.out1)
code_block_19 = CodeBlock { 1; 2; }
address_2 = Charts.MiscNodes.Address(code_block_19.out0, code_block_19.out1)

# group: Number of Change by Category
groupByKey_3 = List.GroupByKey(list=flatten_2@L2, keys=flatten_2@L2)
count_5 = Count(groupByKey_3.groups@L2)
sum = Math.Sum(count_5)
code_block_20 = CodeBlock(x=count_5, y=sum) { Math.Ceiling(x/y*100); }
string = StringInput("Number of Changes by Element Type")
style_3 = Text.Text.Style(arg1=address)
create = Text.Text.Create(string, style_3)
watch_6 = Watch(groupByKey_3.unique_keys)
flatten_3 = Flatten(watch_6)
data_3 = Charts.DonutChart.Data(flatten_3, count_5)
boolean = BoolSelector(false)
style_4 = Charts.DonutChart.Style(arg2=address_2, arg5=boolean)
chart_3 = Charts.DonutChart.Chart(data_3, style_4)
style_5 = Charts.PieChart.Style()
code_block_21 = CodeBlock { 1; 2; }

code_block_22 = CodeBlock { 5; 1; }
address_3 = Charts.MiscNodes.Address(code_block_22.out0, code_block_22.out1)
code_block_23 = CodeBlock { "ChangeType"; }
indexOf_3 = IndexOf(getItemAtIndex_3@L2, code_block_23)
list_getitematindex_change_type = List.GetItemAtIndex(list=getItemAtIndex_2@L2, index=indexOf_3@L1)
flatten_4 = Flatten(list_getitematindex_change_type)
code_block_24 = CodeBlock { 5; 2; }
address_4 = Charts.MiscNodes.Address(code_block_24.out0, code_block_24.out1)

# group: Number of Change by Change Type
string_2 = StringInput("Number of Changes by Change Type")
style_6 = Text.Text.Style(arg1=address_3)
create_2 = Text.Text.Create(string_2, style_6)
groupByKey_4 = List.GroupByKey(list=flatten_2@L2, keys=flatten_4@L2)
watch_7 = Watch(groupByKey_4.unique_keys)
flatten_5 = Flatten(watch_7)
count_6 = Count(groupByKey_4.groups@L2)
boolean_2 = BoolSelector(false)
style_7 = Charts.DonutChart.Style(arg2=address_4, arg5=boolean_2)
sum_2 = Math.Sum(count_6)
code_block_25 = CodeBlock(x=count_6, y=sum_2) { Math.Ceiling(x/y*100); }
style_8 = Charts.PieChart.Style()
code_block_26 = CodeBlock { 1; 2; }

string_from_object = FromObject(flatten_5)

# group (continued): Number of Change by Change Type
data_4 = Charts.DonutChart.Data(string_from_object, count_6)
chart_4 = Charts.DonutChart.Chart(data_4, style_7)

create_report_2 = MandrillReportNode(create, chart_3, create_2, chart_4)
report_window_2 = MandrillWindowNodeModel(create_report_2)
code_block_27 = CodeBlock { "Level"; }
indexOf_4 = IndexOf(getItemAtIndex_3@L2, code_block_27)
list_getitematindex_level = List.GetItemAtIndex(list=getItemAtIndex_2@L2, index=indexOf_4@L1)
flatten_6 = Flatten(list_getitematindex_level)

# group: List of Levels
boolean_3 = BoolSelector(false)
uniqueItems = List.UniqueItems(flatten_6)
sort = List.Sort(uniqueItems)
count_7 = Count(sort@L1)
length = String.Length(sort)
code_block_28 = CodeBlock(x=length) { x>0; }
filterByBoolMask_5 = List.FilterByBoolMask(list=sort, mask=code_block_28)
count_8 = List.Count(filterByBoolMask_5.in)

watch_8 = Watch()  # unwired: arg0
uniqueItems_2 = List.UniqueItems()  # unwired: arg0

# group: List of Categories
uniqueItems_3 = List.UniqueItems(flatten_2)
sort_2 = List.Sort(uniqueItems_3)
count_9 = List.Count(sort_2)

# group: List of Change Types
uniqueItems_4 = List.UniqueItems(flatten_4)
sort_3 = List.Sort(uniqueItems_4)
count_10 = List.Count(sort_3)

file_path_2 = Filename("..\JSON\Test-A-V7-Changes.json")
fromPath_2 = FileObject(file_path_2)  # "File.FromPath"
watch_9 = Watch(fromPath_2)
readFromFile_2 = DynamoJson.FileHelper.ReadFromFile(file_path_2)
toSublists_2 = DynamoJson.JsonParser.ToSublists(readFromFile_2)
toDictionary_2 = DynamoJson.JsonParser.ToDictionary(readFromFile_2)
getKeys_2 = GetKeys(toDictionary_2)
code_block_29 = CodeBlock { "ModelSummary"; }
indexOf_5 = IndexOf(getKeys_2, code_block_29)
getItemAtIndex_4 = List.GetItemAtIndex(list=toSublists_2, index=indexOf_5)
restOfItems_2 = List.RestOfItems(getItemAtIndex_4)
code_block_30 = CodeBlock { 1; }
flatten_7 = List.Flatten(list=restOfItems_2, amt=code_block_30)
groupByKey_5 = List.GroupByKey(list=list_getitematindex_change_type, keys=list_getitematindex_change_type)
create_3 = List.Create()  # unwired: arg0
map = List.Map(list=groupByKey_5.unique_keys, f_x=create_3)
code_block_31 = CodeBlock { 0; }
ofRepeatedItem = List.OfRepeatedItem(item=code_block_31, amount=count_8)
groupByKey_6 = List.GroupByKey(list=flatten_2, keys=list_getitematindex_change_type)
groupByKey_7 = List.GroupByKey(list=groupByKey_6.groups@L2, keys=groupByKey_5.groups@L2)
count_11 = Count(groupByKey_7.unique_keys)
ofRepeatedItem_2 = List.OfRepeatedItem(item=ofRepeatedItem, amount=count_11)
indexOf_6 = IndexOf(filterByBoolMask_5.in, groupByKey_7.unique_keys@@L1)
count_12 = List.Count(groupByKey_7.groups@@L2)
sortByKey = List.SortByKey(list=count_12@L2, keys=groupByKey_7.unique_keys@L2)
replaceItemAtIndex = List.ReplaceItemAtIndex(list=ofRepeatedItem_2@L2, index=indexOf_6@L2, item=sortByKey.sorted_list@L1)
transpose_2 = List.Transpose(replaceItemAtIndex@@L3)
sum_3 = Math.Sum(transpose_2@@L2)
addItemToFront = List.AddItemToFront(item=map@L1, list=sum_3@@L2)
watch_10 = Watch(groupByKey_5.unique_keys)
watch_11 = Watch(sum_3)
code_block_32 = CodeBlock { "Changes"; }
indexOf_7 = IndexOf(getKeys_2, code_block_32)
getItemAtIndex_5 = List.GetItemAtIndex(list=toSublists_2, index=indexOf_7)
restOfItems_3 = List.RestOfItems(getItemAtIndex_5)
code_block_33 = CodeBlock { 1; }
flatten_8 = List.Flatten(list=restOfItems_3, amt=code_block_33)
transpose_3 = List.Transpose(flatten_8@L3)
code_block_34 = CodeBlock { 1; }
getItemAtIndex_6 = List.GetItemAtIndex(list=transpose_3@L3, index=code_block_34)
code_block_35 = CodeBlock { 0; }
getItemAtIndex_7 = List.GetItemAtIndex(list=transpose_3@L3, index=code_block_35)
code_block_36 = CodeBlock { "Level"; }
indexOf_8 = IndexOf(getItemAtIndex_7@L2, code_block_36)
getItemAtIndex_8 = List.GetItemAtIndex(list=getItemAtIndex_6@L2, index=indexOf_8)
flatten_9 = Flatten(getItemAtIndex_8)
code_block_37 = CodeBlock { "ChangeType"; }
indexOf_9 = IndexOf(getItemAtIndex_7@L2, code_block_37)
getItemAtIndex_9 = List.GetItemAtIndex(list=getItemAtIndex_6@L2, index=indexOf_9)
flatten_10 = Flatten(getItemAtIndex_9)
code_block_38 = CodeBlock { "Category"; }
indexOf_10 = IndexOf(getItemAtIndex_7@@L2, code_block_38)
getItemAtIndex_10 = List.GetItemAtIndex(list=getItemAtIndex_6@L2, index=indexOf_10)
flatten_11 = Flatten(getItemAtIndex_10)
groupByKey_8 = List.GroupByKey(list=groupByKey_7.groups@L2, keys=groupByKey_7.groups@L2)
indexOf_11 = IndexOf()  # unwired: arg0, arg1
code_block_39 = CodeBlock { "ModelSummary"; }
indexOf_12 = IndexOf(getKeys, code_block_39)
getItemAtIndex_11 = List.GetItemAtIndex(list=toSublists, index=indexOf_12)
restOfItems_4 = List.RestOfItems(getItemAtIndex_11)
code_block_40 = CodeBlock { 1; }
flatten_12 = List.Flatten(list=restOfItems_4, amt=code_block_40)
transpose_4 = List.Transpose(flatten_12)
code_block_41 = CodeBlock { 0; }
getItemAtIndex_12 = List.GetItemAtIndex(list=transpose_4@L3, index=code_block_41)
flatten_13 = Flatten(getItemAtIndex_12)
sortByKey_2 = List.SortByKey(list=flatten_13, keys=flatten_13)
code_block_42 = CodeBlock { 1; }
getItemAtIndex_13 = List.GetItemAtIndex(list=transpose_4@L3, index=code_block_42)
flatten_14 = Flatten(getItemAtIndex_13)
sortByKey_3 = List.SortByKey(list=flatten_14, keys=flatten_13)
sortByKey_4 = List.SortByKey(list=flatten_3, keys=flatten_3)
containsItem_2 = List.ContainsItem(list=flatten_13, item=sortByKey_4.sorted_list)
filterByBoolMask_6 = List.FilterByBoolMask(list=sortByKey_4.sorted_list, mask=containsItem_2)
indexOf_13 = IndexOf(flatten_13, filterByBoolMask_6.in@L1)
getItemAtIndex_14 = List.GetItemAtIndex(list=flatten_14, index=indexOf_13)
sortByKey_5 = List.SortByKey(list=count_5, keys=flatten_3)
code_block_43 = CodeBlock(x=getItemAtIndex_14, y=sortByKey_5.sorted_list) { x/y; }
getItemAtIndex_15 = List.GetItemAtIndex(list=flatten_13, index=indexOf_13)
