# Dynamo graph JsonParser-Assembly3.dyn (Dynamo 1.2.0.2690)

code_block = CodeBlock { 2; }
dropEveryNthItem = List.DropEveryNthItem(n=code_block)  # unwired: list
dropEveryNthItem_2 = List.DropEveryNthItem(list=dropEveryNthItem, n=code_block)
dropEveryNthItem_3 = List.DropEveryNthItem(list=dropEveryNthItem_2, n=code_block)
groupByKey = List.GroupByKey(list=dropEveryNthItem_3, keys=dropEveryNthItem_3)
groupByKey_2 = List.GroupByKey()  # unwired: list, keys
count = Count(groupByKey_2.groups@L2)
code_block_2 = CodeBlock(x=count) { x<300; }
filterByBoolMask = List.FilterByBoolMask(list=groupByKey_2.unique_keys, mask=code_block_2)
watch = Watch(filterByBoolMask.out)
containsItem = List.ContainsItem(list=watch, item=groupByKey.groups)
filterByBoolMask_2 = List.FilterByBoolMask(list=groupByKey.groups, mask=containsItem)
count_2 = Count(filterByBoolMask_2.out@L2)
watch_2 = Watch()  # unwired: arg0
firstItem = List.FirstItem(watch_2@L2)
file_path = Filename("..\test%20models\DME2032_sample%20tower_v2017%20-%20changed-Changes.json")
fromPath = FileObject(file_path)  # "File.FromPath"
watch_3 = Watch(fromPath)
readFromFile = DynamoJson.FileHelper.ReadFromFile(file_path)
toSublists = DynamoJson.JsonParser.ToSublists(readFromFile)
toDictionary = DynamoJson.JsonParser.ToDictionary(readFromFile)
getKeys = GetKeys(toDictionary)
code_block_3 = CodeBlock { "Changes"; }
indexOf = IndexOf(getKeys, code_block_3)
getItemAtIndex = List.GetItemAtIndex(list=toSublists, index=indexOf)
restOfItems = List.RestOfItems(getItemAtIndex)
code_block_4 = CodeBlock { 1; }
flatten = List.Flatten(list=restOfItems, amt=code_block_4)
transpose = List.Transpose(flatten@L3)
code_block_5 = CodeBlock { 1; }
getItemAtIndex_2 = List.GetItemAtIndex(list=transpose@L3, index=code_block_5)
code_block_6 = CodeBlock { 0; }
getItemAtIndex_3 = List.GetItemAtIndex(list=transpose@L3, index=code_block_6)
code_block_7 = CodeBlock { "Category"; }
indexOf_2 = IndexOf(getItemAtIndex_3@@L2, code_block_7)
list_getitematindex_category = List.GetItemAtIndex(list=getItemAtIndex_2@L2, index=indexOf_2@L1)
flatten_2 = Flatten(list_getitematindex_category)
code_block_8 = CodeBlock { 1; 1; }
address = Charts.MiscNodes.Address(code_block_8.out0, code_block_8.out1)
code_block_9 = CodeBlock { 1; 2; }
address_2 = Charts.MiscNodes.Address(code_block_9.out0, code_block_9.out1)

# group: Number of Change by Category
groupByKey_3 = List.GroupByKey(list=flatten_2@L2, keys=flatten_2@L2)
count_3 = Count(groupByKey_3.groups@L2)
sum = Math.Sum(count_3)
code_block_10 = CodeBlock(x=count_3, y=sum) { Math.Ceiling(x/y*100); }
string = StringInput("Number of Changes by Element Type")
style = Text.Text.Style(arg1=address)
create = Text.Text.Create(string, style)
watch_4 = Watch(groupByKey_3.unique_keys)
flatten_3 = Flatten(watch_4)
data = Charts.DonutChart.Data(flatten_3, count_3)
boolean = BoolSelector(false)
style_2 = Charts.DonutChart.Style(arg2=address_2, arg5=boolean)
chart = Charts.DonutChart.Chart(data, style_2)
style_3 = Charts.PieChart.Style()
code_block_11 = CodeBlock { 1; 2; }

code_block_12 = CodeBlock { 5; 1; }
address_3 = Charts.MiscNodes.Address(code_block_12.out0, code_block_12.out1)
code_block_13 = CodeBlock { "ChangeType"; }
indexOf_3 = IndexOf(getItemAtIndex_3@L2, code_block_13)
list_getitematindex_change_type = List.GetItemAtIndex(list=getItemAtIndex_2@L2, index=indexOf_3@L1)
flatten_4 = Flatten(list_getitematindex_change_type)
code_block_14 = CodeBlock { 5; 2; }
address_4 = Charts.MiscNodes.Address(code_block_14.out0, code_block_14.out1)

# group: Number of Change by Change Type
string_2 = StringInput("Number of Changes by Change Type")
style_4 = Text.Text.Style(arg1=address_3)
create_2 = Text.Text.Create(string_2, style_4)
groupByKey_4 = List.GroupByKey(list=flatten_2@L2, keys=flatten_4@L2)
watch_5 = Watch(groupByKey_4.unique_keys)
flatten_5 = Flatten(watch_5)
count_4 = Count(groupByKey_4.groups@L2)
boolean_2 = BoolSelector(false)
style_5 = Charts.DonutChart.Style(arg2=address_4, arg5=boolean_2)
sum_2 = Math.Sum(count_4)
code_block_15 = CodeBlock(x=count_4, y=sum_2) { Math.Ceiling(x/y*100); }
style_6 = Charts.PieChart.Style()
code_block_16 = CodeBlock { 1; 2; }

string_from_object = FromObject(flatten_5)

# group (continued): Number of Change by Change Type
data_2 = Charts.DonutChart.Data(string_from_object, count_4)
chart_2 = Charts.DonutChart.Chart(data_2, style_5)

code_block_17 = CodeBlock { "ModelSummary"; }
indexOf_4 = IndexOf(getKeys, code_block_17)
getItemAtIndex_4 = List.GetItemAtIndex(list=toSublists, index=indexOf_4)
restOfItems_2 = List.RestOfItems(getItemAtIndex_4)
code_block_18 = CodeBlock { 1; }
flatten_6 = List.Flatten(list=restOfItems_2, amt=code_block_18)
transpose_2 = List.Transpose(flatten_6)
code_block_19 = CodeBlock { 0; }
getItemAtIndex_5 = List.GetItemAtIndex(list=transpose_2@L3, index=code_block_19)
flatten_7 = Flatten(getItemAtIndex_5)
sortByKey = List.SortByKey(list=flatten_3, keys=flatten_3)
containsItem_2 = List.ContainsItem(list=flatten_7, item=sortByKey.sorted_list)
filterByBoolMask_3 = List.FilterByBoolMask(list=sortByKey.sorted_list, mask=containsItem_2)
indexOf_5 = IndexOf(flatten_7, filterByBoolMask_3.in@L1)
getItemAtIndex_6 = List.GetItemAtIndex(list=flatten_7, index=indexOf_5)
sortByKey_2 = List.SortByKey(list=count_3, keys=flatten_3)
filterByBoolMask_4 = List.FilterByBoolMask(list=sortByKey_2.sorted_list, mask=containsItem_2)
code_block_20 = CodeBlock { 1; }
getItemAtIndex_7 = List.GetItemAtIndex(list=transpose_2@L3, index=code_block_20)
flatten_8 = Flatten(getItemAtIndex_7)
getItemAtIndex_8 = List.GetItemAtIndex(list=flatten_8, index=indexOf_5)
code_block_21 = CodeBlock(y=filterByBoolMask_4.in, x=getItemAtIndex_8) { Math.Ceiling(y/x*100); }
maximumItem = List.MaximumItem(code_block_21)
code_block_22 = CodeBlock(x=maximumItem) { 0; x+5; }
domain = Charts.MiscNodes.Domain(code_block_22.out0, code_block_22.out1)
data_3 = Charts.BarChart.Data(getItemAtIndex_6, code_block_21, domain)
code_block_23 = CodeBlock { 1; 8; }
address_5 = Charts.MiscNodes.Address(code_block_23.out0, code_block_23.out1)
code_block_24 = CodeBlock { 150; }
margins = Charts.MiscNodes.Margins(arg1=code_block_24)
code_block_25 = CodeBlock { 600; }
code_block_26 = CodeBlock { "Percent of Items Changed by Category"; }
code_block_27 = CodeBlock { 3; }
code_block_28 = CodeBlock { 90; }
style_7 = Charts.BarChart.Style(arg2=address_5, arg3=margins, arg4=code_block_25, arg5=code_block_25, arg6=code_block_26, arg7=code_block_27, arg8=code_block_28)
chart_3 = Charts.BarChart.Chart(data_3, style_7)
string_3 = StringInput("Number of Changes by Level Shown by Category")
code_block_29 = CodeBlock { 10; 7; }
address_6 = Charts.MiscNodes.Address(code_block_29.out0, code_block_29.out1)
style_8 = Text.Text.Style(arg1=address_6)
create_3 = Text.Text.Create(string_3, style_8)
code_block_30 = CodeBlock { "LEVELS"; }
code_block_31 = CodeBlock { "LevelNames"; }
indexOf_6 = IndexOf(getKeys, code_block_31)
getItemAtIndex_9 = List.GetItemAtIndex(list=toSublists, index=indexOf_6)
restOfItems_3 = List.RestOfItems(getItemAtIndex_9)
flatten_9 = Flatten(restOfItems_3)
code_block_32 = CodeBlock { "Level"; "Lvl"; }
replace = String.Replace(str=flatten_9, searchFor=code_block_32.out0, replaceWith=code_block_32.out1)
addItemToFront = List.AddItemToFront(item=code_block_30, list=replace)
code_block_33 = CodeBlock { "Level"; }
indexOf_7 = IndexOf(getItemAtIndex_3@L2, code_block_33)
list_getitematindex_level = List.GetItemAtIndex(list=getItemAtIndex_2@L2, index=indexOf_7@L1)
flatten_10 = Flatten(list_getitematindex_level)
code_block_34 = CodeBlock { ""; }
ne = flatten_10 != code_block_34
filterByBoolMask_5 = List.FilterByBoolMask(list=flatten_10, mask=ne)
filterByBoolMask_6 = List.FilterByBoolMask(list=flatten_2, mask=ne)
groupByKey_5 = List.GroupByKey(list=filterByBoolMask_5.in, keys=filterByBoolMask_6.in)
create_4 = List.Create()  # unwired: arg0
map = List.Map(list=groupByKey_5.unique_keys, f_x=create_4)
code_block_35 = CodeBlock { 0; }
count_5 = Count(flatten_9)
ofRepeatedItem = List.OfRepeatedItem(item=code_block_35, amount=count_5)
groupByKey_6 = List.GroupByKey(list=filterByBoolMask_6.in, keys=filterByBoolMask_6.in)
groupByKey_7 = List.GroupByKey(list=groupByKey_6.groups@L2, keys=groupByKey_5.groups@L2)
count_6 = Count(groupByKey_7.unique_keys)
ofRepeatedItem_2 = List.OfRepeatedItem(item=ofRepeatedItem, amount=count_6)
indexOf_8 = IndexOf(flatten_9, groupByKey_7.unique_keys@@L1)
count_7 = List.Count(groupByKey_7.groups@@L2)
sortByKey_3 = List.SortByKey(list=count_7@L2, keys=groupByKey_7.unique_keys@L2)
replaceItemAtIndex = List.ReplaceItemAtIndex(list=ofRepeatedItem_2@L2, index=indexOf_8@L2, item=sortByKey_3.sorted_list@L1)
transpose_3 = List.Transpose(replaceItemAtIndex@@L3)
sum_3 = Math.Sum(transpose_3@@L2, lacing=Longest)
addItemToFront_2 = List.AddItemToFront(item=map@L1, list=sum_3@L2)
data_4 = Charts.ParallelCoordinates.Data(addItemToFront, addItemToFront_2)
code_block_36 = CodeBlock { 8; 9; }
address_7 = Charts.MiscNodes.Address(code_block_36.out0, code_block_36.out1)
style_9 = Charts.ParallelCoordinates.Style(arg1=address_7)
chart_4 = Charts.ParallelCoordinates.Chart(data_4, style_9)
string_4 = StringInput("Number of Changes by Level Shown by Category")
code_block_37 = CodeBlock { 1; 7; }
address_8 = Charts.MiscNodes.Address(code_block_37.out0, code_block_37.out1)
style_10 = Text.Text.Style(arg1=address_8)
create_5 = Text.Text.Create(string_4, style_10)
code_block_38 = CodeBlock { "Change Type"; }

# group: List of Change Types
uniqueItems = List.UniqueItems(flatten_4)
sort = List.Sort(uniqueItems)
count_8 = List.Count(sort)

watch_6 = Watch(sort)
watch_7 = Watch(watch_6)
addItemToFront_3 = List.AddItemToFront(item=code_block_38, list=watch_7)
watch_8 = Watch(flatten_4)
watch_9 = Watch(watch_8)
watch_10 = Watch(watch_8)
code_block_39 = CodeBlock { ""; }
ne_2 = watch_10 != code_block_39
filterByBoolMask_7 = List.FilterByBoolMask(list=watch_9, mask=ne_2)
watch_11 = Watch(flatten_2)
filterByBoolMask_8 = List.FilterByBoolMask(list=watch_11, mask=ne_2)
groupByKey_8 = List.GroupByKey(list=filterByBoolMask_7.in, keys=filterByBoolMask_8.in)
create_6 = List.Create()  # unwired: arg0
map_2 = List.Map(list=groupByKey_8.unique_keys, f_x=create_6)
code_block_40 = CodeBlock { 0; }
watch_12 = Watch(watch_6)
count_9 = Count(watch_12)
ofRepeatedItem_3 = List.OfRepeatedItem(item=code_block_40, amount=count_9)
groupByKey_9 = List.GroupByKey(list=filterByBoolMask_8.in, keys=filterByBoolMask_8.in)
groupByKey_10 = List.GroupByKey(list=groupByKey_9.groups@L2, keys=groupByKey_8.groups@L2)
count_10 = Count(groupByKey_10.unique_keys)
ofRepeatedItem_4 = List.OfRepeatedItem(item=ofRepeatedItem_3, amount=count_10)
watch_13 = Watch(watch_6)
indexOf_9 = IndexOf(watch_13, groupByKey_10.unique_keys@@L1)
count_11 = List.Count(groupByKey_10.groups@@L2)
sortByKey_4 = List.SortByKey(list=count_11@L2, keys=groupByKey_10.unique_keys@L2)
replaceItemAtIndex_2 = List.ReplaceItemAtIndex(list=ofRepeatedItem_4@L2, index=indexOf_9@L2, item=sortByKey_4.sorted_list@L1)
transpose_4 = List.Transpose(replaceItemAtIndex_2@@L3)
sum_4 = Math.Sum(transpose_4@@L2, lacing=Longest)
addItemToFront_4 = List.AddItemToFront(item=map_2@L1, list=sum_4@L2)
restOfItems_4 = List.RestOfItems(addItemToFront_4@L2)
sum_5 = Math.Sum(restOfItems_4)
maximumItem_2 = List.MaximumItem(sum_5)
code_block_41 = CodeBlock(x=maximumItem_2) { x+5; }
domain_2 = Charts.MiscNodes.Domain(arg1=code_block_41)
data_5 = Charts.StackedBarChart.Data(addItemToFront_3, addItemToFront_4, domain_2)
code_block_42 = CodeBlock { 8; 9; }
address_9 = Charts.MiscNodes.Address(code_block_42.out0, code_block_42.out1)
style_11 = Charts.StackedBarChart.Style(arg2=address_9)
chart_5 = Charts.StackedBarChart.Chart(data_5, style_11)
create_report = MandrillReportNode(create, chart, create_2, chart_2, chart_3, create_3, chart_4, create_5, chart_5)
report_window = MandrillWindowNodeModel(create_report)

# group: List of Levels
boolean_3 = BoolSelector(false)
uniqueItems_2 = List.UniqueItems(flatten_10)
sort_2 = List.Sort(uniqueItems_2)
count_12 = Count(sort_2@L1)
length = String.Length(sort_2)
code_block_43 = CodeBlock(x=length) { x>0; }
filterByBoolMask_9 = List.FilterByBoolMask(list=sort_2, mask=code_block_43)
count_13 = List.Count(filterByBoolMask_9.in)

watch_14 = Watch()  # unwired: arg0
uniqueItems_3 = List.UniqueItems()  # unwired: arg0

# group: List of Categories
uniqueItems_4 = List.UniqueItems(flatten_2)
sort_3 = List.Sort(uniqueItems_4)
count_14 = List.Count(sort_3)

file_path_2 = Filename("..\JSON\Test-A-V7-Changes.json")
fromPath_2 = FileObject(file_path_2)  # "File.FromPath"
watch_15 = Watch(fromPath_2)
readFromFile_2 = DynamoJson.FileHelper.ReadFromFile(file_path_2)
toSublists_2 = DynamoJson.JsonParser.ToSublists(readFromFile_2)
toDictionary_2 = DynamoJson.JsonParser.ToDictionary(readFromFile_2)
getKeys_2 = GetKeys(toDictionary_2)
code_block_44 = CodeBlock { "ModelSummary"; }
indexOf_10 = IndexOf(getKeys_2, code_block_44)
getItemAtIndex_10 = List.GetItemAtIndex(list=toSublists_2, index=indexOf_10)
restOfItems_5 = List.RestOfItems(getItemAtIndex_10)
code_block_45 = CodeBlock { 1; }
flatten_11 = List.Flatten(list=restOfItems_5, amt=code_block_45)
groupByKey_11 = List.GroupByKey(list=list_getitematindex_change_type, keys=list_getitematindex_change_type)
create_7 = List.Create()  # unwired: arg0
map_3 = List.Map(list=groupByKey_11.unique_keys, f_x=create_7)
code_block_46 = CodeBlock { 0; }
ofRepeatedItem_5 = List.OfRepeatedItem(item=code_block_46, amount=count_13)
groupByKey_12 = List.GroupByKey(list=flatten_2, keys=list_getitematindex_change_type)
groupByKey_13 = List.GroupByKey(list=groupByKey_12.groups@L2, keys=groupByKey_11.groups@L2)
count_15 = Count(groupByKey_13.unique_keys)
ofRepeatedItem_6 = List.OfRepeatedItem(item=ofRepeatedItem_5, amount=count_15)
indexOf_11 = IndexOf(filterByBoolMask_9.in, groupByKey_13.unique_keys@@L1)
count_16 = List.Count(groupByKey_13.groups@@L2)
sortByKey_5 = List.SortByKey(list=count_16@L2, keys=groupByKey_13.unique_keys@L2)
replaceItemAtIndex_3 = List.ReplaceItemAtIndex(list=ofRepeatedItem_6@L2, index=indexOf_11@L2, item=sortByKey_5.sorted_list@L1)
transpose_5 = List.Transpose(replaceItemAtIndex_3@@L3)
sum_6 = Math.Sum(transpose_5@@L2)
addItemToFront_5 = List.AddItemToFront(item=map_3@L1, list=sum_6@@L2)
watch_16 = Watch(groupByKey_11.unique_keys)
watch_17 = Watch(sum_6)
code_block_47 = CodeBlock { "Changes"; }
indexOf_12 = IndexOf(getKeys_2, code_block_47)
getItemAtIndex_11 = List.GetItemAtIndex(list=toSublists_2, index=indexOf_12)
restOfItems_6 = List.RestOfItems(getItemAtIndex_11)
code_block_48 = CodeBlock { 1; }
flatten_12 = List.Flatten(list=restOfItems_6, amt=code_block_48)
transpose_6 = List.Transpose(flatten_12@L3)
code_block_49 = CodeBlock { 1; }
getItemAtIndex_12 = List.GetItemAtIndex(list=transpose_6@L3, index=code_block_49)
code_block_50 = CodeBlock { 0; }
getItemAtIndex_13 = List.GetItemAtIndex(list=transpose_6@L3, index=code_block_50)
code_block_51 = CodeBlock { "Level"; }
indexOf_13 = IndexOf(getItemAtIndex_13@L2, code_block_51)
getItemAtIndex_14 = List.GetItemAtIndex(list=getItemAtIndex_12@L2, index=indexOf_13)
flatten_13 = Flatten(getItemAtIndex_14)
code_block_52 = CodeBlock { "ChangeType"; }
indexOf_14 = IndexOf(getItemAtIndex_13@L2, code_block_52)
getItemAtIndex_15 = List.GetItemAtIndex(list=getItemAtIndex_12@L2, index=indexOf_14)
flatten_14 = Flatten(getItemAtIndex_15)
code_block_53 = CodeBlock { "Category"; }
indexOf_15 = IndexOf(getItemAtIndex_13@@L2, code_block_53)
getItemAtIndex_16 = List.GetItemAtIndex(list=getItemAtIndex_12@L2, index=indexOf_15)
flatten_15 = Flatten(getItemAtIndex_16)
groupByKey_14 = List.GroupByKey(list=groupByKey_13.groups@L2, keys=groupByKey_13.groups@L2)
indexOf_16 = IndexOf()  # unwired: arg0, arg1
sortByKey_6 = List.SortByKey(list=flatten_7, keys=flatten_7)
sortByKey_7 = List.SortByKey(list=flatten_8, keys=flatten_7)
watch_18 = Watch()  # unwired: arg0
groupByKey_15 = List.GroupByKey(list=filterByBoolMask_5.in, keys=filterByBoolMask_5.in)

# group: List of Levels
uniqueItems_5 = List.UniqueItems(flatten_10)
length_2 = String.Length(uniqueItems_5)
code_block_54 = CodeBlock(x=length_2) { x>0; }
filterByBoolMask_10 = List.FilterByBoolMask(list=uniqueItems_5, mask=code_block_54)

groupByKey_16 = List.GroupByKey(list=filterByBoolMask_7.in, keys=filterByBoolMask_7.in)
string_5 = StringInput("Number of Changes by Level Shown by Category")
code_block_55 = CodeBlock { 10; 7; }
address_10 = Charts.MiscNodes.Address(code_block_55.out0, code_block_55.out1)
style_12 = Text.Text.Style(arg1=address_10)
create_8 = Text.Text.Create(string_5, style_12)
