# Dynamo graph JsonParser-PiChart2.dyn (Dynamo 1.2.0.2690)

file_path = Filename(".\sample%20family%20export_day1%20-%20trimmed.xlsx")
fromPath = FileObject(file_path)  # "File.FromPath"
code_block = CodeBlock { "Dynamo"; }
readFromFile = Excel.ReadFromFile(file=fromPath, sheetName=code_block)
firstItem = List.FirstItem(readFromFile@L2)  # frozen
boolean = BoolSelector(true)
clean = List.Clean(list=firstItem, preserveIndices=boolean)
groupByKey = List.GroupByKey(list=clean, keys=clean)
count = Count(groupByKey.groups@L2)
code_block_2 = CodeBlock(x=count) { x<300; }
filterByBoolMask = List.FilterByBoolMask(list=groupByKey.unique_keys, mask=code_block_2)
watch = Watch(filterByBoolMask.in)
filterByBoolMask_2 = List.FilterByBoolMask(list=count, mask=code_block_2)
watch_2 = Watch(filterByBoolMask_2.in)
maximumItem = List.MaximumItem(watch_2)
code_block_3 = CodeBlock(x=maximumItem) { x+5; 0; }
domain = Charts.MiscNodes.Domain(code_block_3.out1, code_block_3.out0)
data = Charts.BarChart.Data(watch, watch_2, domain)
code_block_4 = CodeBlock { 150; }
margins = Charts.MiscNodes.Margins(arg1=code_block_4)
code_block_5 = CodeBlock { 900; }
code_block_6 = CodeBlock { "Total Number of Changed Items"; }
code_block_7 = CodeBlock { 3; }
code_block_8 = CodeBlock { 90; }
style = Charts.BarChart.Style(arg3=margins, arg4=code_block_5, arg5=code_block_5, arg6=code_block_6, arg7=code_block_7, arg8=code_block_8)
chart = Charts.BarChart.Chart(data, style)
create_report = MandrillReportNode(chart)  # unwired: arg1, arg2
report_window = MandrillWindowNodeModel(create_report)
code_block_9 = CodeBlock { 2; }
dropEveryNthItem = List.DropEveryNthItem(list=clean, n=code_block_9)
dropEveryNthItem_2 = List.DropEveryNthItem(list=dropEveryNthItem, n=code_block_9)
dropEveryNthItem_3 = List.DropEveryNthItem(list=dropEveryNthItem_2, n=code_block_9)
groupByKey_2 = List.GroupByKey(list=dropEveryNthItem_3, keys=dropEveryNthItem_3)
watch_3 = Watch(filterByBoolMask.out)
containsItem = List.ContainsItem(list=watch_3, item=groupByKey_2.groups)
filterByBoolMask_3 = List.FilterByBoolMask(list=groupByKey_2.groups, mask=containsItem)
count_2 = Count(filterByBoolMask_3.out@L2)
code_block_10 = CodeBlock(x=count_2) { x>0; }
filterByBoolMask_4 = List.FilterByBoolMask(list=filterByBoolMask_3.out, mask=code_block_10)
watch_4 = Watch(filterByBoolMask_4.in)
firstItem_2 = List.FirstItem(watch_4@L2)
count_3 = Count(filterByBoolMask_4.in@L2)
count_4 = Count(count_3)
randomList = Math.RandomList(count_4)
code_block_11 = CodeBlock(x=randomList) { x*50; }
code_block_12 = CodeBlock(x=count_3, y=code_block_11) { x+y; }
ceiling = Math.Ceiling(code_block_12)
code_block_13 = CodeBlock(x=count_3, y=ceiling) { x/y*100; }
maximumItem_2 = List.MaximumItem(code_block_13)
domain_2 = Charts.MiscNodes.Domain(arg1=maximumItem_2)
data_2 = Charts.LineChart.Data(firstItem_2, code_block_13, domain_2)
style_2 = Charts.LineChart.Style()
chart_2 = Charts.LineChart.Chart(data_2, style_2)
file_path_2 = Filename("..\..\Dropbox\AEC%20Tech%20Hackathon%202016\JSON\Test-A-V7-Changes.json")
fromPath_2 = FileObject(file_path_2)  # "File.FromPath"
watch_5 = Watch(fromPath_2)
readFromFile_2 = DynamoJson.FileHelper.ReadFromFile()  # unwired: arg0
readFromFile_3 = DynamoJson.FileHelper.ReadFromFile(file_path_2)
toSublists = DynamoJson.JsonParser.ToSublists(readFromFile_3)
toDictionary = DynamoJson.JsonParser.ToDictionary(readFromFile_3)
getKeys = GetKeys(toDictionary)
code_block_14 = CodeBlock { "ModelSummary"; }
indexOf = IndexOf(getKeys, code_block_14)
getItemAtIndex = List.GetItemAtIndex(list=toSublists, index=indexOf)
restOfItems = List.RestOfItems(getItemAtIndex)
code_block_15 = CodeBlock { 1; }
flatten = List.Flatten(list=restOfItems, amt=code_block_15)
code_block_16 = CodeBlock { "Changes"; }
indexOf_2 = IndexOf(getKeys, code_block_16)
getItemAtIndex_2 = List.GetItemAtIndex(list=toSublists, index=indexOf_2)
restOfItems_2 = List.RestOfItems(getItemAtIndex_2)
code_block_17 = CodeBlock { 1; }
flatten_2 = List.Flatten(list=restOfItems_2, amt=code_block_17)
transpose = List.Transpose(flatten_2@L3)
code_block_18 = CodeBlock { 1; }
getItemAtIndex_3 = List.GetItemAtIndex(list=transpose@L3, index=code_block_18)
code_block_19 = CodeBlock { 0; }
getItemAtIndex_4 = List.GetItemAtIndex(list=transpose@L3, index=code_block_19)
code_block_20 = CodeBlock { "Category"; }
indexOf_3 = IndexOf(getItemAtIndex_4@@L2, code_block_20)
list_getitematindex_category = List.GetItemAtIndex(list=getItemAtIndex_3@L2, index=indexOf_3)
flatten_3 = Flatten(list_getitematindex_category)
code_block_21 = CodeBlock { "ChangeType"; }
indexOf_4 = IndexOf(getItemAtIndex_4@L2, code_block_21)
list_getitematindex_change_type = List.GetItemAtIndex(list=getItemAtIndex_3@L2, index=indexOf_4)
flatten_4 = Flatten(list_getitematindex_change_type)
groupByKey_3 = List.GroupByKey(list=flatten_3@L2, keys=flatten_4@L2)
groupByKey_4 = List.GroupByKey(list=flatten_4@L2, keys=flatten_4@L2)
code_block_22 = CodeBlock { "Level"; }
indexOf_5 = IndexOf(getItemAtIndex_4@L2, code_block_22)
list_getitematindex_level = List.GetItemAtIndex(list=getItemAtIndex_3@L2, index=indexOf_5)
flatten_5 = Flatten(list_getitematindex_level)
groupByKey_5 = List.GroupByKey(list=flatten_5@L2, keys=flatten_4@L2)
code_block_23 = CodeBlock { 1; 1; }
address = Charts.MiscNodes.Address(code_block_23.out0, code_block_23.out1)
code_block_24 = CodeBlock { 1; 2; }
address_2 = Charts.MiscNodes.Address(code_block_24.out0, code_block_24.out1)

# group: Number of Change by Category
groupByKey_6 = List.GroupByKey(list=flatten_3@L2, keys=flatten_3@L2)
count_5 = Count(groupByKey_6.groups@L2)
sum = Math.Sum(count_5)
code_block_25 = CodeBlock(x=count_5, y=sum) { Math.Ceiling(x/y*100); }
string = StringInput("Number of Changes by Element Type")
style_3 = Text.Text.Style(arg1=address)
create = Text.Text.Create(string, style_3)
watch_6 = Watch(groupByKey_6.unique_keys)
flatten_6 = Flatten(watch_6)
data_3 = Charts.DonutChart.Data(flatten_6, count_5)
boolean_2 = BoolSelector(false)
style_4 = Charts.DonutChart.Style(arg2=address_2, arg5=boolean_2)
chart_3 = Charts.DonutChart.Chart(data_3, style_4)
style_5 = Charts.PieChart.Style()
code_block_26 = CodeBlock { 1; 2; }

code_block_27 = CodeBlock { 5; 1; }
address_3 = Charts.MiscNodes.Address(code_block_27.out0, code_block_27.out1)
code_block_28 = CodeBlock { 5; 2; }
address_4 = Charts.MiscNodes.Address(code_block_28.out0, code_block_28.out1)

# group: Number of Change by Change Type
string_2 = StringInput("Number of Changes by Change Type")
style_6 = Text.Text.Style(arg1=address_3)
create_2 = Text.Text.Create(string_2, style_6)
groupByKey_7 = List.GroupByKey(list=flatten_3@L2, keys=flatten_4@L2)
watch_7 = Watch(groupByKey_7.unique_keys)
flatten_7 = Flatten(watch_7)
count_6 = Count(groupByKey_7.groups@L2)
boolean_3 = BoolSelector(false)
style_7 = Charts.DonutChart.Style(arg2=address_4, arg5=boolean_3)
sum_2 = Math.Sum(count_6)
code_block_29 = CodeBlock(x=count_6, y=sum_2) { Math.Ceiling(x/y*100); }
style_8 = Charts.PieChart.Style()
code_block_30 = CodeBlock { 1; 2; }

string_from_object = FromObject(flatten_7)

# group (continued): Number of Change by Change Type
data_4 = Charts.DonutChart.Data(string_from_object, count_6)
chart_4 = Charts.DonutChart.Chart(data_4, style_7)

create_report_2 = MandrillReportNode(create, chart_3, create_2, chart_4)
report_window_2 = MandrillWindowNodeModel(create_report_2)

# group: List of Levels
boolean_4 = BoolSelector(false)
uniqueItems = List.UniqueItems(flatten_5)
sort = List.Sort(uniqueItems)
count_7 = Count(sort@L1)
length = String.Length(sort)
code_block_31 = CodeBlock(x=length) { x>0; }
filterByBoolMask_5 = List.FilterByBoolMask(list=sort, mask=code_block_31)
count_8 = List.Count(filterByBoolMask_5.in)

watch_8 = Watch()  # unwired: arg0
uniqueItems_2 = List.UniqueItems()  # unwired: arg0

# group: List of Categories
uniqueItems_3 = List.UniqueItems(flatten_3)
sort_2 = List.Sort(uniqueItems_3)
count_9 = List.Count(sort_2)

# group: List of Change Types
uniqueItems_4 = List.UniqueItems(flatten_4)
sort_3 = List.Sort(uniqueItems_4)
count_10 = List.Count(sort_3)
