# Dynamo graph JsonParser_parallel coordinates chart_v4.dyn (Dynamo 1.2.0.2690)

code_block = CodeBlock { "LEVELS"; }
file_path = Filename("..\..\..\..\..\Desktop\AEC%20Tech%20Hackathon%202016\_team\sample%20family%20export_day1%20-%20trimmed.xlsx")
fromPath = FileObject(file_path)  # "File.FromPath"
code_block_2 = CodeBlock { "Dynamo"; }
readFromFile = Excel.ReadFromFile(file=fromPath, sheetName=code_block_2)
transpose = List.Transpose(readFromFile)
boolean = BoolSelector(false)
clean = List.Clean(list=transpose@L2, preserveIndices=boolean)
code_block_3 = CodeBlock(IN=clean) { IN[0]; }
code_block_4 = CodeBlock(IN=clean) { IN[2]; }
groupByKey = List.GroupByKey(list=code_block_3, keys=code_block_4)
code_block_5 = CodeBlock(IN=clean) { IN[1]; }
groupByKey_2 = List.GroupByKey(list=code_block_5, keys=code_block_4)
groupByKey_3 = List.GroupByKey(list=groupByKey.groups@L2, keys=groupByKey_2.groups@L2)
count = Count(groupByKey_3.groups@@L2)
sortByKey = List.SortByKey(list=count@L2, keys=groupByKey_3.unique_keys@L2)
firstItem = List.FirstItem(sortByKey.sorted_keys)
addItemToFront = List.AddItemToFront(item=code_block, list=firstItem)
flatten = Flatten(sortByKey.sorted_list@L2)
addItemToFront_2 = List.AddItemToFront(item=groupByKey.unique_keys@L1, list=flatten@L2)
data = Charts.ParallelCoordinates.Data(addItemToFront, addItemToFront_2)
style = Charts.ParallelCoordinates.Style()
chart = Charts.ParallelCoordinates.Chart(data, style)
file_path_2 = Filename("..\test%20models\DME2032_sample%20tower_v2017%20-%20changed-Changes.json")
fromPath_2 = FileObject(file_path_2)  # "File.FromPath"
watch = Watch(fromPath_2)
readFromFile_2 = DynamoJson.FileHelper.ReadFromFile()  # unwired: arg0
readFromFile_3 = DynamoJson.FileHelper.ReadFromFile(file_path_2)
toSublists = DynamoJson.JsonParser.ToSublists(readFromFile_3)
toDictionary = DynamoJson.JsonParser.ToDictionary(readFromFile_3)
getKeys = GetKeys(toDictionary)
code_block_6 = CodeBlock { "ModelSummary"; }
indexOf = IndexOf(getKeys, code_block_6)
getItemAtIndex = List.GetItemAtIndex(list=toSublists, index=indexOf)
restOfItems = List.RestOfItems(getItemAtIndex)
code_block_7 = CodeBlock { 1; }
flatten_2 = List.Flatten(list=restOfItems, amt=code_block_7)
code_block_8 = CodeBlock { "Changes"; }
indexOf_2 = IndexOf(getKeys, code_block_8)
getItemAtIndex_2 = List.GetItemAtIndex(list=toSublists, index=indexOf_2)
restOfItems_2 = List.RestOfItems(getItemAtIndex_2)
code_block_9 = CodeBlock { 1; }
flatten_3 = List.Flatten(list=restOfItems_2, amt=code_block_9)
transpose_2 = List.Transpose(flatten_3@L3)
code_block_10 = CodeBlock { 1; }
getItemAtIndex_3 = List.GetItemAtIndex(list=transpose_2@L3, index=code_block_10)
code_block_11 = CodeBlock { 0; }
getItemAtIndex_4 = List.GetItemAtIndex(list=transpose_2@L3, index=code_block_11)
code_block_12 = CodeBlock { "ChangeType"; }
indexOf_3 = IndexOf(getItemAtIndex_4@L2, code_block_12)
getItemAtIndex_5 = List.GetItemAtIndex(list=getItemAtIndex_3@L2, index=indexOf_3)
flatten_4 = Flatten(getItemAtIndex_5)
code_block_13 = CodeBlock { "Level "; }

# group: replace Level count
code_block_14 = CodeBlock { 1..23; }

string_from_object = FromObject(code_block_14)
add = code_block_13 + string_from_object
code_block_15 = CodeBlock { "Category"; }
indexOf_4 = IndexOf(getItemAtIndex_4@@L2, code_block_15)
getItemAtIndex_6 = List.GetItemAtIndex(list=getItemAtIndex_3@L2, index=indexOf_4)
flatten_5 = Flatten(getItemAtIndex_6)
code_block_16 = CodeBlock { "Level"; }
indexOf_5 = IndexOf(getItemAtIndex_4@L2, code_block_16)
getItemAtIndex_7 = List.GetItemAtIndex(list=getItemAtIndex_3@L2, index=indexOf_5)
flatten_6 = Flatten(getItemAtIndex_7)
code_block_17 = CodeBlock { ""; }
ne = flatten_6 != code_block_17
filterByBoolMask = List.FilterByBoolMask(list=flatten_5, mask=ne)
groupByKey_4 = List.GroupByKey(list=filterByBoolMask.in, keys=filterByBoolMask.in)
filterByBoolMask_2 = List.FilterByBoolMask(list=flatten_6, mask=ne)
groupByKey_5 = List.GroupByKey(list=filterByBoolMask_2.in, keys=filterByBoolMask.in)
groupByKey_6 = List.GroupByKey(list=groupByKey_4.groups@L2, keys=groupByKey_5.groups@L2)
groupByKey_7 = List.GroupByKey(list=groupByKey_6.groups@L2, keys=groupByKey_6.groups@L2)
code_block_18 = CodeBlock { "LEVELS"; }
groupByKey_8 = List.GroupByKey(list=filterByBoolMask_2.in, keys=filterByBoolMask_2.in)
addItemToFront_3 = List.AddItemToFront(item=code_block_18, list=groupByKey_8.unique_keys)
create = List.Create()  # unwired: arg0
map = List.Map(list=groupByKey_5.unique_keys, f_x=create)
code_block_19 = CodeBlock { 0; }

# group: List of Levels
uniqueItems = List.UniqueItems(flatten_6)
length = String.Length(uniqueItems)
code_block_20 = CodeBlock(x=length) { x>0; }
filterByBoolMask_3 = List.FilterByBoolMask(list=uniqueItems, mask=code_block_20)

count_2 = Count(filterByBoolMask_3.in)
ofRepeatedItem = List.OfRepeatedItem(item=code_block_19, amount=count_2)
count_3 = Count(groupByKey_6.unique_keys)
ofRepeatedItem_2 = List.OfRepeatedItem(item=ofRepeatedItem, amount=count_3)
indexOf_6 = IndexOf(filterByBoolMask_3.in, groupByKey_6.unique_keys@@L1)
count_4 = List.Count(groupByKey_6.groups@@L2)
sortByKey_2 = List.SortByKey(list=count_4@L2, keys=groupByKey_6.unique_keys@L2)
replaceItemAtIndex = List.ReplaceItemAtIndex(list=ofRepeatedItem_2@L2, index=indexOf_6@L2, item=sortByKey_2.sorted_list@L1)
transpose_3 = List.Transpose(replaceItemAtIndex@@L3)
sum = Math.Sum(transpose_3@@L2, lacing=Longest)
addItemToFront_4 = List.AddItemToFront(item=map@L1, list=sum@L2)
data_2 = Charts.ParallelCoordinates.Data(addItemToFront_3, addItemToFront_4)
style_2 = Charts.ParallelCoordinates.Style()
chart_2 = Charts.ParallelCoordinates.Chart(data_2, style_2)
create_report = MandrillReportNode(chart_2)
report_window = MandrillWindowNodeModel(create_report)
