# Dynamo graph JsonParser-PiChart1.dyn (Dynamo 1.2.0.2690)

select_model_elements = DSModelElementsSelection()
getCategory = Element.GetCategory(select_model_elements)
string_from_object = FromObject(getCategory)
groupByKey = List.GroupByKey(list=select_model_elements, keys=string_from_object)
string_from_object_2 = FromObject(groupByKey.groups)
watch = Watch(string_from_object_2)
boolean = BoolSelector(true)
createJsonString = DynamoJson.JsonBuilder.CreateJsonString(watch, boolean)
watch_2 = Watch(createJsonString)
writeToFile = CSV.WriteToFile(arg1=watch_2)  # unwired: arg0
file_path = Filename("C:\Users\hazell\Desktop\Fingerprint\file.json")
writeToFile_2 = DynamoJson.FileHelper.WriteToFile(watch_2, file_path)
data = Charts.StackedBarChart.Data()  # unwired: arg0, arg1
dataFromCSV = Charts.StackedBarChart.DataFromCSV()  # unwired: arg0
style = Charts.StackedBarChart.Style()
chart = Charts.StackedBarChart.Chart(arg1=style)  # unwired: arg0
address = Charts.MiscNodes.Address()
toSublists = DynamoJson.JsonParser.ToSublists(watch_2)
count = Count(toSublists@L2)
id = Element.Id(groupByKey.groups)
file_path_2 = Filename("C:\Users\hazell\Desktop\Fingerprint\sample family export_day2.xlsx")
fromPath = FileObject(file_path_2)  # "File.FromPath"
file_path_3 = Filename(".\sample%20family%20export_day1%20-%20trimmed.xlsx")
fromPath_2 = FileObject(file_path_3)  # "File.FromPath"
code_block = CodeBlock { "Dynamo"; }
readFromFile = Excel.ReadFromFile(file=fromPath_2, sheetName=code_block)
firstItem = List.FirstItem(readFromFile@L2)  # frozen
boolean_2 = BoolSelector(true)
clean = List.Clean(list=firstItem, preserveIndices=boolean_2)
groupByKey_2 = List.GroupByKey(list=clean, keys=clean)
count_2 = Count(groupByKey_2.groups@L2)
code_block_2 = CodeBlock(x=count_2) { x<300; }
filterByBoolMask = List.FilterByBoolMask(list=groupByKey_2.unique_keys, mask=code_block_2)
watch_3 = Watch(filterByBoolMask.in)
filterByBoolMask_2 = List.FilterByBoolMask(list=count_2, mask=code_block_2)
watch_4 = Watch(filterByBoolMask_2.in)
maximumItem = List.MaximumItem(watch_4)
code_block_3 = CodeBlock(x=maximumItem) { x+5; 0; }
domain = Charts.MiscNodes.Domain(code_block_3.out1, code_block_3.out0)
data_2 = Charts.BarChart.Data(watch_3, watch_4, domain)
code_block_4 = CodeBlock { 150; }
margins = Charts.MiscNodes.Margins(arg1=code_block_4)
code_block_5 = CodeBlock { 900; }
code_block_6 = CodeBlock { "Total Number of Changed Items"; }
code_block_7 = CodeBlock { 3; }
code_block_8 = CodeBlock { 90; }
style_2 = Charts.BarChart.Style(arg3=margins, arg4=code_block_5, arg5=code_block_5, arg6=code_block_6, arg7=code_block_7, arg8=code_block_8)
chart_2 = Charts.BarChart.Chart(data_2, style_2)
create_report = MandrillReportNode(chart_2)  # unwired: arg1, arg2
report_window = MandrillWindowNodeModel(create_report)
data_3 = Charts.ParallelCoordinates.Data()  # unwired: arg0, arg1
address_2 = Charts.MiscNodes.Address()
style_3 = Charts.ParallelCoordinates.Style(arg1=address_2)
chart_3 = Charts.ParallelCoordinates.Chart(data_3, style_3)
code_block_9 = CodeBlock { 2; }
dropEveryNthItem = List.DropEveryNthItem(list=clean, n=code_block_9)
dropEveryNthItem_2 = List.DropEveryNthItem(list=dropEveryNthItem, n=code_block_9)
dropEveryNthItem_3 = List.DropEveryNthItem(list=dropEveryNthItem_2, n=code_block_9)
groupByKey_3 = List.GroupByKey(list=dropEveryNthItem_3, keys=dropEveryNthItem_3)
watch_5 = Watch(filterByBoolMask.out)
containsItem = List.ContainsItem(list=watch_5, item=groupByKey_3.groups)
filterByBoolMask_3 = List.FilterByBoolMask(list=groupByKey_3.groups, mask=containsItem)
count_3 = Count(filterByBoolMask_3.out@L2)
code_block_10 = CodeBlock(x=count_3) { x>0; }
filterByBoolMask_4 = List.FilterByBoolMask(list=filterByBoolMask_3.out, mask=code_block_10)
watch_6 = Watch(filterByBoolMask_4.in)
firstItem_2 = List.FirstItem(watch_6@L2)
count_4 = Count(filterByBoolMask_4.in@L2)
count_5 = Count(count_4)
randomList = Math.RandomList(count_5)
code_block_11 = CodeBlock(x=randomList) { x*50; }
code_block_12 = CodeBlock(x=count_4, y=code_block_11) { x+y; }
ceiling = Math.Ceiling(code_block_12)
code_block_13 = CodeBlock(x=count_4, y=ceiling) { x/y*100; }
maximumItem_2 = List.MaximumItem(code_block_13)
domain_2 = Charts.MiscNodes.Domain(arg1=maximumItem_2)
data_4 = Charts.LineChart.Data(firstItem_2, code_block_13, domain_2)
style_4 = Charts.LineChart.Style()
chart_4 = Charts.LineChart.Chart(data_4, style_4)
code_block_14 = CodeBlock { {0,1,2}; }
getItemAtIndex = List.GetItemAtIndex(list=readFromFile@L2, index=code_block_14)  # frozen
code_block_15 = CodeBlock { 1; }
getItemAtIndex_2 = List.GetItemAtIndex(list=getItemAtIndex@L2, index=code_block_15)
groupByKey_4 = List.GroupByKey(list=getItemAtIndex, keys=getItemAtIndex_2)
code_block_16 = CodeBlock { 0; }
getItemAtIndex_3 = List.GetItemAtIndex(list=getItemAtIndex@L2, index=code_block_16)
groupByKey_5 = List.GroupByKey(list=getItemAtIndex, keys=getItemAtIndex_3)
count_6 = List.Count(groupByKey_5.groups@@L3)
code_block_17 = CodeBlock { 2; }
getItemAtIndex_4 = List.GetItemAtIndex(list=groupByKey_5.groups@@L2, index=code_block_17)
groupByKey_6 = List.GroupByKey(list=groupByKey_5.groups@L3, keys=getItemAtIndex_4@L2)
watch_7 = Watch(groupByKey_6.groups)
code_block_18 = CodeBlock { 0; }
getItemAtIndex_5 = List.GetItemAtIndex(list=watch_7@@L2, index=code_block_18)
firstItem_3 = List.FirstItem(getItemAtIndex_5@L3)
firstItem_4 = List.FirstItem(firstItem_3@L2)
code_block_19 = CodeBlock { 2; }
getItemAtIndex_6 = List.GetItemAtIndex(list=watch_7@@L2, index=code_block_19)
firstItem_5 = List.FirstItem(getItemAtIndex_6@L3)
firstItem_6 = List.FirstItem(firstItem_5@L2)
count_7 = List.Count(firstItem_3@L2)
count_8 = List.Count(watch_7@@L3)
code_block_20 = CodeBlock { 0; }
getItemAtIndex_7 = List.GetItemAtIndex(list=watch_7@@L3, index=code_block_20)
code_block_21 = CodeBlock { "LEVELS"; }
transpose = List.Transpose(readFromFile)
boolean_3 = BoolSelector(false)
clean_2 = List.Clean(list=transpose@L2, preserveIndices=boolean_3)
code_block_22 = CodeBlock(IN=clean_2) { IN[0]; }
code_block_23 = CodeBlock(IN=clean_2) { IN[2]; }
groupByKey_7 = List.GroupByKey(list=code_block_22, keys=code_block_23)
code_block_24 = CodeBlock(IN=clean_2) { IN[1]; }
groupByKey_8 = List.GroupByKey(list=code_block_24, keys=code_block_23)
groupByKey_9 = List.GroupByKey(list=groupByKey_7.groups@L2, keys=groupByKey_8.groups@L2)
count_9 = Count(groupByKey_9.groups@@L2)
sortByKey = List.SortByKey(list=count_9@L2, keys=groupByKey_9.unique_keys@L2)
firstItem_7 = List.FirstItem(sortByKey.sorted_keys)
addItemToFront = List.AddItemToFront(item=code_block_21, list=firstItem_7)
flatten = Flatten(sortByKey.sorted_list@L2)
addItemToFront_2 = List.AddItemToFront(item=groupByKey_7.unique_keys@L1, list=flatten@L2)
data_5 = Charts.ParallelCoordinates.Data(addItemToFront, addItemToFront_2)
style_5 = Charts.ParallelCoordinates.Style()
chart_5 = Charts.ParallelCoordinates.Chart(data_5, style_5)
file_path_4 = Filename("..\..\Dropbox\AEC%20Tech%20Hackathon%202016\JSON\Test-A-V7-Changes.json")
fromPath_3 = FileObject(file_path_4)  # "File.FromPath"
watch_8 = Watch(fromPath_3)
readFromFile_2 = DynamoJson.FileHelper.ReadFromFile()  # unwired: arg0
readFromFile_3 = DynamoJson.FileHelper.ReadFromFile(file_path_4)
toSublists_2 = DynamoJson.JsonParser.ToSublists(readFromFile_3)
toDictionary = DynamoJson.JsonParser.ToDictionary(readFromFile_3)
getKeys = GetKeys(toDictionary)
code_block_25 = CodeBlock { "ModelSummary"; }
indexOf = IndexOf(getKeys, code_block_25)
getItemAtIndex_8 = List.GetItemAtIndex(list=toSublists_2, index=indexOf)
restOfItems = List.RestOfItems(getItemAtIndex_8)
code_block_26 = CodeBlock { 1; }
flatten_2 = List.Flatten(list=restOfItems, amt=code_block_26)
code_block_27 = CodeBlock { "Changes"; }
indexOf_2 = IndexOf(getKeys, code_block_27)
getItemAtIndex_9 = List.GetItemAtIndex(list=toSublists_2, index=indexOf_2)
restOfItems_2 = List.RestOfItems(getItemAtIndex_9)
code_block_28 = CodeBlock { 1; }
flatten_3 = List.Flatten(list=restOfItems_2, amt=code_block_28)
transpose_2 = List.Transpose(flatten_3@L3)
code_block_29 = CodeBlock { 1; }
getItemAtIndex_10 = List.GetItemAtIndex(list=transpose_2@L3, index=code_block_29)
code_block_30 = CodeBlock { 0; }
getItemAtIndex_11 = List.GetItemAtIndex(list=transpose_2@L3, index=code_block_30)
code_block_31 = CodeBlock { "Category"; }
indexOf_3 = IndexOf(getItemAtIndex_11@@L2, code_block_31)
getItemAtIndex_12 = List.GetItemAtIndex(list=getItemAtIndex_10@L2, index=indexOf_3)
flatten_4 = Flatten(getItemAtIndex_12)
code_block_32 = CodeBlock { "ChangeType"; }
indexOf_4 = IndexOf(getItemAtIndex_11@L2, code_block_32)
getItemAtIndex_13 = List.GetItemAtIndex(list=getItemAtIndex_10@L2, index=indexOf_4)
flatten_5 = Flatten(getItemAtIndex_13)
groupByKey_10 = List.GroupByKey(list=flatten_4@L2, keys=flatten_5@L2)
groupByKey_11 = List.GroupByKey(list=flatten_5@L2, keys=flatten_5@L2)
code_block_33 = CodeBlock { "Level"; }
indexOf_5 = IndexOf(getItemAtIndex_11@L2, code_block_33)
getItemAtIndex_14 = List.GetItemAtIndex(list=getItemAtIndex_10@L2, index=indexOf_5)
flatten_6 = Flatten(getItemAtIndex_14)
groupByKey_12 = List.GroupByKey(list=flatten_6@L2, keys=flatten_5@L2)
groupByKey_13 = List.GroupByKey(list=flatten_4@L2, keys=flatten_4@L2)
watch_9 = Watch(groupByKey_13.unique_keys)
count_10 = Count(groupByKey_13.groups@L2)
sum = Math.Sum(count_10)
code_block_34 = CodeBlock(x=count_10, y=sum) { Math.Ceiling(x/y*100) + "%"; }
data_6 = Charts.PieChart.Data(watch_9, code_block_34)
chart_6 = Charts.PieChart.Chart(data_6)  # unwired: arg1
data_7 = Charts.DonutChart.Data(watch_9, sum)
style_6 = Charts.DonutChart.Style()
chart_7 = Charts.DonutChart.Chart(data_7, style_6)
create = Text.Text.Create()  # unwired: arg0, arg1
