# Dynamo graph JsonParser_parallel coordinates chart.dyn (Dynamo 1.2.0.2690)

code_block = CodeBlock { "LEVELS"; }
file_path = Filename("..\..\..\..\..\Desktop\AEC%20Tech%20Hackathon%202016\_team\sample%20family%20export_day1%20-%20trimmed.xlsx")
fromPath = FileObject(file_path)  # "File.FromPath"
code_block_2 = CodeBlock { "Dynamo"; }
readFromFile = Excel.ReadFromFile(file=fromPath, sheetName=code_block_2)
transpose = List.Transpose(readFromFile)
boolean = BoolSelector(false)
clean = List.Clean(list=transpose@L2, preserveIndices=boolean)
code_block_3 = CodeBlock(IN=clean) { IN[0]; }
code_block_4 = CodeBlock(IN=clean) { IN[2]; }
groupByKey = List.GroupByKey(list=code_block_3, keys=code_block_4)
code_block_5 = CodeBlock(IN=clean) { IN[1]; }
groupByKey_2 = List.GroupByKey(list=code_block_5, keys=code_block_4)
groupByKey_3 = List.GroupByKey(list=groupByKey.groups@L2, keys=groupByKey_2.groups@L2)
count = Count(groupByKey_3.groups@@L2)
sortByKey = List.SortByKey(list=count@L2, keys=groupByKey_3.unique_keys@L2)
firstItem = List.FirstItem(sortByKey.sorted_keys)
addItemToFront = List.AddItemToFront(item=code_block, list=firstItem)
flatten = Flatten(sortByKey.sorted_list@L2)
addItemToFront_2 = List.AddItemToFront(item=groupByKey.unique_keys@L1, list=flatten@L2)
data = Charts.ParallelCoordinates.Data(addItemToFront, addItemToFront_2)
style = Charts.ParallelCoordinates.Style()
chart = Charts.ParallelCoordinates.Chart(data, style)
file_path_2 = Filename("..\JSON\Test-A-V7-Changes.json")
fromPath_2 = FileObject(file_path_2)  # "File.FromPath"
watch = Watch(fromPath_2)
readFromFile_2 = DynamoJson.FileHelper.ReadFromFile()  # unwired: arg0
readFromFile_3 = DynamoJson.FileHelper.ReadFromFile(file_path_2)
toSublists = DynamoJson.JsonParser.ToSublists(readFromFile_3)
toDictionary = DynamoJson.JsonParser.ToDictionary(readFromFile_3)
getKeys = GetKeys(toDictionary)
code_block_6 = CodeBlock { "ModelSummary"; }
indexOf = IndexOf(getKeys, code_block_6)
getItemAtIndex = List.GetItemAtIndex(list=toSublists, index=indexOf)
restOfItems = List.RestOfItems(getItemAtIndex)
code_block_7 = CodeBlock { 1; }
flatten_2 = List.Flatten(list=restOfItems, amt=code_block_7)
code_block_8 = CodeBlock { "Changes"; }
indexOf_2 = IndexOf(getKeys, code_block_8)
getItemAtIndex_2 = List.GetItemAtIndex(list=toSublists, index=indexOf_2)
restOfItems_2 = List.RestOfItems(getItemAtIndex_2)
code_block_9 = CodeBlock { 1; }
flatten_3 = List.Flatten(list=restOfItems_2, amt=code_block_9)
transpose_2 = List.Transpose(flatten_3@L3)
code_block_10 = CodeBlock { 1; }
getItemAtIndex_3 = List.GetItemAtIndex(list=transpose_2@L3, index=code_block_10)
code_block_11 = CodeBlock { 0; }
getItemAtIndex_4 = List.GetItemAtIndex(list=transpose_2@L3, index=code_block_11)
code_block_12 = CodeBlock { "Category"; }
indexOf_3 = IndexOf(getItemAtIndex_4@@L2, code_block_12)
getItemAtIndex_5 = List.GetItemAtIndex(list=getItemAtIndex_3@L2, index=indexOf_3)
flatten_4 = Flatten(getItemAtIndex_5)
code_block_13 = CodeBlock { "ChangeType"; }
indexOf_4 = IndexOf(getItemAtIndex_4@L2, code_block_13)
getItemAtIndex_6 = List.GetItemAtIndex(list=getItemAtIndex_3@L2, index=indexOf_4)
flatten_5 = Flatten(getItemAtIndex_6)
groupByKey_4 = List.GroupByKey(list=flatten_4@L2, keys=flatten_5@L2)
groupByKey_5 = List.GroupByKey(list=flatten_5@L2, keys=flatten_5@L2)
code_block_14 = CodeBlock { "Level"; }
indexOf_5 = IndexOf(getItemAtIndex_4@L2, code_block_14)
getItemAtIndex_7 = List.GetItemAtIndex(list=getItemAtIndex_3@L2, index=indexOf_5)
flatten_6 = Flatten(getItemAtIndex_7)
groupByKey_6 = List.GroupByKey(list=flatten_6@L2, keys=flatten_5@L2)
groupByKey_7 = List.GroupByKey(list=flatten_4@L2, keys=flatten_4@L2)
count_2 = Count(groupByKey_7.groups@L2)
watch_2 = Watch(groupByKey_7.unique_keys)
