# Dynamo graph data viz_parallel coordinates_json.dyn (Dynamo 1.2.0.2690)

code_block = CodeBlock { 0; }
address = Charts.MiscNodes.Address(code_block, code_block)
code_block_2 = CodeBlock { "LEVELS"; }
file_path = Filename("exports%20from%20Matt\Test-A-V2-Changes%203.json")
fromPath = FileObject(file_path)  # "File.FromPath"
code_block_3 = CodeBlock { "Dynamo"; }
boolean = BoolSelector(true)
readFromFile = Excel.ReadFromFile(file=fromPath, sheetName=code_block_3, readAsStrings=boolean)  # frozen
transpose = List.Transpose(readFromFile)
boolean_2 = BoolSelector(false)
clean = List.Clean(list=transpose@L2, preserveIndices=boolean_2)
code_block_4 = CodeBlock(IN=clean) { IN[0]; }
code_block_5 = CodeBlock(IN=clean) { IN[2]; }
groupByKey = List.GroupByKey(list=code_block_4, keys=code_block_5)
code_block_6 = CodeBlock(IN=clean) { IN[1]; }
groupByKey_2 = List.GroupByKey(list=code_block_6, keys=code_block_5)
groupByKey_3 = List.GroupByKey(list=groupByKey.groups@L2, keys=groupByKey_2.groups@L2)
count = Count(groupByKey_3.groups@@L2)
sortByKey = List.SortByKey(list=count@L2, keys=groupByKey_3.unique_keys@L2)
firstItem = List.FirstItem(sortByKey.sorted_keys)
addItemToFront = List.AddItemToFront(item=code_block_2, list=firstItem)
flatten = Flatten(sortByKey.sorted_list@L2)
addItemToFront_2 = List.AddItemToFront(item=groupByKey.unique_keys@L1, list=flatten@L2)
data = Charts.ParallelCoordinates.Data(addItemToFront, addItemToFront_2)
style = Charts.ParallelCoordinates.Style()
chart = Charts.ParallelCoordinates.Chart(data, style)
create_report = MandrillReportNode(chart)
report_window = MandrillWindowNodeModel(create_report)
readFromFile_2 = DynamoJson.FileHelper.ReadFromFile(file_path)
toDictionary = DynamoJson.JsonParser.ToDictionary(readFromFile_2)
getKeys = GetKeys(toDictionary)
watch = Watch(getKeys)
toSublists = DynamoJson.JsonParser.ToSublists(readFromFile_2)
code_block_7 = CodeBlock(IN=toSublists) { IN[5][1]; }
transpose_2 = List.Transpose(code_block_7)
firstItem_2 = List.FirstItem(transpose_2)
lastItem = List.LastItem(transpose_2)
lastItem_2 = List.LastItem(transpose_2)
minimumItem = List.MinimumItem(lastItem_2)
integer_slider_domain_offset = IntegerSlider(5, range=0..10 step 1)
sub = minimumItem - integer_slider_domain_offset
maximumItem = List.MaximumItem(lastItem_2)
add = maximumItem + integer_slider_domain_offset
domain = Charts.MiscNodes.Domain(sub, add)
data_2 = Charts.BarChart.Data(firstItem_2, lastItem, domain)
style_2 = Charts.BarChart.Style()
chart_2 = Charts.BarChart.Chart(data_2, style_2)
create_report_2 = MandrillReportNode(chart_2)
report_window_2 = MandrillWindowNodeModel(create_report_2)
